# Grasshopper definition Suspension.gh (Grasshopper 1.0.7)
# plug-ins: Human

python = GhPythonScript()  # -> path
# ---------- python: Python ----------
import os

def find_git_help_script():
    # Get the path to the GH file
    doc = ghenv.Component.OnPingDocument()
    file_path = doc.FilePath
    if not file_path:
        print "File not saved"
        return None

    current_dir = os.path.dirname(file_path)  # Current directory of the .gh file
    parent_dir = os.path.dirname(current_dir)  # One level higher

    py_dir = os.path.join(parent_dir, "Py")  # Expected Py folder
    target_file = os.path.join(py_dir, "git_help.py")

    if os.path.exists(target_file):
        print "✅ Found git_help.py:", target_file
        return target_file
    else:
        print "❌ The file git_help.py was not found in:", py_dir
        return None

path = find_git_help_script()
# ---------- end python ----------
file = ReadFile(File=python, PerLineParse=False)
python_2 = GhPythonScript(Code=file, OPEN_MAIN_BRANCH=Button(), OPEN_HELP_IN_GITHUB=Button(), OPEN_LOCAL_HELP=Button())  # -> Out, Md
panel = Panel(python_2.Md)

data = Data([null x119])

ghpython_script = GhPythonScript(doublepolys=data)  # -> out, simplify(geometry), simplify(idx), simplify(lookup_geometry)
# ---------- ghpython_script: Python ----------
import Rhino.Geometry as rg

geometry = []
idx = []
lookup_geometry = []

for segfirst, segfinal in zip(doublepolys.firstpass.segments, doublepolys.finalpass.segments):
    geometry.append(segfinal.geometry)
    print dir(segfinal)
    idx.append(segfirst.lookupid)
    lookup_geometry.append(segfirst.lookup_geometry)
#break
# ---------- end ghpython_script ----------
python_3 = GhPythonScript(objects=flatten(ghpython_script.geometry), indices=flatten(ghpython_script.idx))  # -> out, out_objects; inputs objects: list, indices: list of Int32
# ---------- python_3: Python ----------
import Grasshopper as gh
import Rhino.Geometry as rg

tree = gh.DataTree[object]()

for i, obj in enumerate(objects):
    path_index = indices[i]
    path = gh.Kernel.Data.GH_Path(path_index)
    tree.Add(obj, path)

out_objects = tree
# ---------- end python_3 ----------
crv = Curve(python_3.out_objects)
lng = ListLength(List=crv)
equals = Equality(FirstNumber=lng, SecondNumber="1")  # -> Equality, Inequality
cull = CullPattern(List=crv, CullPattern=equals.Inequality)
crv_2 = Curve(cull)

clean = CleanTree(RemoveNulls=True, RemoveInvalid=True, RemoveEmpty=invert(False), Tree=crv_2)
number_slider = Slider(19.1, range=0..24)
rod_step = Slider(33, range=0..100)
rod_step_2 = Slider(14, range=0..100)
python_4 = GhPythonScript(
    LINES=clean,
    ROUNDING=Slider(10, range=0..30),
    MIN_DISTANCE_CORNER=Slider(12, range=0..100),
    MAX_DISTANCE_CORNER=Slider(42, range=0..100),
    SUSPENSION_STEP=Slider(108, range=0..150),
    MAX_DIST_B_PT_CENTER=Slider(12, range=0..24),
    THRESHOLD_FILTER=number_slider,
    RODS_STEP=rod_step,
    DISTANCE_JOINING_START_END_LINES=rod_step_2)  # -> out, start_line, end_line, start_lonely, end_lonely, cut_line, safe_support_lines, orphaned_points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; inputs LINES: list of Line
# ---------- python_4: Python ----------
import Rhino.Geometry as rg
import Grasshopper as gh
from collections import defaultdict
import math

ghenv.Component.Message = "v0.06 suspension"

GLOBAL_TOL = 0.01

def sort_lines_perpendicular(lines, reference_direction):
    """
    Sort lines perpendicular to the reference direction.
    
    Args:
        lines: List of lines to sort
        reference_direction: Reference direction vector (Vector3d)
    
    Returns:
        Sorted list of lines
    """
    # find the vector perpendicular to reference_direction
    perp_vector = rg.Vector3d(-reference_direction.Y, reference_direction.X, 0)
    perp_vector.Unitize()

    # sort by the projection of the point line.From onto this vector
    def projection_key(line):
        pt = line.From
        vec = rg.Vector3d(pt.X, pt.Y, pt.Z)
        return vec * perp_vector  # scalar projection

    sorted_lines = sorted(lines, key=projection_key)
    return sorted_lines


def line_same_direction(lines):
    """
    Align all lines in the same direction and sort them perpendicularly.
    
    Args:
        lines: List of lines to align
    
    Returns:
        Tuple of (aligned lines, reference direction)
    """
    if not lines:
        return
    
    reference_line = lines[0]
    reference_direction = rg.Vector3d(reference_line.Direction)
    reference_direction.Unitize()
    
    aligned_lines = []
    
    for line in lines:
        direction = line.Direction
        direction.Unitize()
        if reference_direction * direction < 0:
            flipped_lene = rg.Line(line.To, line.From)
            aligned_lines.append(flipped_lene)
        else:
            aligned_lines.append(line)
    return sort_lines_perpendicular(aligned_lines, reference_direction), reference_direction


def suspension_corners(lines, dir, round, min_val, is_start):
    """
    Generate suspension corner points with rounding and minimum distance consideration.
    
    Args:
        lines: List of lines
        dir: Direction vector
        round: Rounding radius
        min_val: Minimum distance
        is_start: Whether these are start points (True/False)
    
    Returns:
        List of corner points
    """
    pt = []
    for line in lines:
        if is_start:
            min_start_pt = rg.Point3d(line.From)
            min_vector = dir * (round + min_val)
        else:
            min_start_pt = rg.Point3d(line.To)
            min_vector = dir * -1 * (round + min_val)
        min_xform = rg.Transform.Translation(min_vector)
        min_start_pt.Transform(min_xform)
        
        pt.append(min_start_pt)
    return pt


def strict_cluster_points(points, direction, max_distance, is_start=True):
    """
    Group points into clusters based on projection onto the given direction.
    
    Args:
        points: List of points
        direction: Direction for projection
        max_distance: Maximum distance between points in a cluster
        is_start: Whether these are start points
    
    Returns:
        Tuple of (group indices, representative points)
    """
    direction = rg.Vector3d(direction)
    direction.Unitize()
    
    # secure verification
    projections = []
    for idx, pt in enumerate(points):
        vec = rg.Vector3d(pt)
        scalar_proj = vec * direction
        projections.append((idx, scalar_proj))
    
    group_ids = [-1] * len(points)
    current_group = 0
    remaining = set(range(len(points)))
    representative_points = []

    while remaining:
        seed_idx = next(iter(remaining))
        group = [seed_idx]
        group_ids[seed_idx] = current_group
        remaining.remove(seed_idx)

        changed = True
        while changed:
            changed = False
            to_add = []
            for idx in remaining:
                if all(abs(projections[idx][1] - projections[gi][1]) <= max_distance for gi in group):
                    to_add.append(idx)
                    group_ids[idx] = current_group
                    changed = True
            for idx in to_add:
                group.append(idx)
                remaining.remove(idx)

        # Select a representative point in the group
        best_idx = max(
            group,
            key=lambda idx: projections[idx][1] if is_start else -projections[idx][1]
        )
        representative_points.append(points[best_idx])
        current_group += 1
    
    return group_ids, representative_points


def project_points_to_group_scalar(points, group_ids, representative_points, direction):
    """
    Project points to their group representative points along the given direction.
    
    Args:
        points: List of points
        group_ids: Group indices for each point
        representative_points: Representative points for groups
        direction: Projection direction
    
    Returns:
        List of aligned points
    """
    aligned_pts = []
    direction = rg.Vector3d(direction)
    direction.Unitize()
    
    rep_projections = []
    for pt in representative_points:
        rep_projections.append(rg.Vector3d(pt) * direction)
    
    for idx, pt in enumerate(points):
        group_id = group_ids[idx]
        target_proj = rep_projections[group_id]
        pt_vec = rg.Vector3d(pt)
        current_proj = pt_vec * direction
        shift_scalar = target_proj - current_proj
        shift_vec = direction * shift_scalar
        new_pt = rg.Point3d(pt)
        new_pt.Transform(rg.Transform.Translation(shift_vec))
        aligned_pts.append(new_pt)

    return aligned_pts


def grouped_polylines_by_index(points, group_indices):
    """
    Create polylines from points based on their group indices.
    
    Args:
        points: List of points
        group_indices: Group indices for points
    
    Returns:
        Tuple of (polylines, lonely points)
    """
    grouped = defaultdict(list)
    
    for pt, group_id in zip(points, group_indices):
        grouped[group_id].append(pt)
    
    polylines = []
    lonely_points = []
    one_point_for_group = []

    for group_id in sorted(grouped.keys()):
        pts = grouped[group_id]
        if len(pts) >= 2:
            one_point_for_group.append(pts[0])
            poly = rg.Polyline(pts)
            polyline_curve = rg.PolylineCurve(poly)
            polylines.append(polyline_curve)
        elif len(pts) == 1:
            lonely_points.append(pts[0])

    return polylines, lonely_points, one_point_for_group


#===============================================================================================================================

def connect_point_pairs(start_points, end_points):
    """
    Create lines between pairs of start and end points.
    
    Args:
        start_points: Start points
        end_points: End points
    
    Returns:
        List of lines
    """
    lines = []
    count = min(len(start_points), len(end_points))  # secure verification
    for i in range(count):
        line = rg.Line(start_points[i], end_points[i])
        lines.append(line)
    return lines


def generate_crossbars_points(lines, max_step, group_points=None):
    """
    Generate points for crossbars with uniform step spacing.
    
    Args:
        lines: List of lines
        max_step: Maximum step between crossbars
        group_points: Optional list of group points to define projection range
    
    Returns:
        List of point lists for crossbars
    """
    ref_dir = rg.Vector3d(lines[0].Direction)
    ref_dir.Unitize()

    # 1. Determine projection range
    if group_points:
        # Use provided group points + line points for projection range
        group_projections = [rg.Vector3d(pt) * ref_dir for pt in group_points]
        # Add all line points to consider line extents
        all_line_pts = [line.From for line in lines] + [line.To for line in lines]
        line_projections = [rg.Vector3d(pt) * ref_dir for pt in all_line_pts]
        # Combine all projections and sort
        all_projections = group_projections + line_projections
        projections = sorted(set(all_projections))  # Remove duplicates and sort
    else:
        # Use all line points for projection range (original behavior)
        all_pts = [line.From for line in lines] + [line.To for line in lines]
        projections = [rg.Vector3d(pt) * ref_dir for pt in all_pts]
        t_min = min(projections)
        t_max = max(projections)
        total_length = t_max - t_min

        if total_length < 1e-6:
            return []

        # Original behavior
        num_sections = int(total_length // max_step) + 1
        actual_step = total_length / num_sections

        crossbar_points = []
        for i in range(num_sections + 1):
            t = t_min + i * actual_step
            pts_on_lines = []
            for line in lines:
                start_proj = rg.Vector3d(line.From) * ref_dir
                end_proj = rg.Vector3d(line.To) * ref_dir

                if start_proj <= t <= end_proj or end_proj <= t <= start_proj:
                    length_proj = end_proj - start_proj
                    if abs(length_proj) < 1e-6:
                        continue
                    ratio = (t - start_proj) / length_proj
                    pt = line.PointAt(ratio)
                    pts_on_lines.append(pt)

            if len(pts_on_lines) >= 1:
                crossbar_points.append(pts_on_lines)

        return crossbar_points

    # 2. For group_points: process each segment between adjacent points
    crossbar_points = []
    
    # Process each segment between adjacent group points
    for i in range(len(projections) - 1):
        segment_start = projections[i]
        segment_end = projections[i + 1]
        segment_length = segment_end - segment_start
        
        if segment_length < 1e-6:
            continue
            
        # Calculate number of steps for this segment
        num_steps = max(1, int(math.ceil(segment_length / max_step)))
        step_size = segment_length / num_steps
        
        # Generate points for this segment
        for j in range(num_steps + 1):
            t = segment_start + j * step_size
            pts_on_lines = []
            
            for line in lines:
                start_proj = rg.Vector3d(line.From) * ref_dir
                end_proj = rg.Vector3d(line.To) * ref_dir

                if start_proj <= t <= end_proj or end_proj <= t <= start_proj:
                    length_proj = end_proj - start_proj
                    if abs(length_proj) < 1e-6:
                        continue
                    ratio = (t - start_proj) / length_proj
                    pt = line.PointAt(ratio)
                    pts_on_lines.append(pt)

            if len(pts_on_lines) >= 1:
                crossbar_points.append(pts_on_lines)

    return crossbar_points


def remove_duplicate_points(points, min_distance=GLOBAL_TOL):
    """
    Remove duplicate points that are closer than min_distance.
    
    Args:
        points: List of points
        min_distance: Minimum distance between points
    
    Returns:
        List of unique points
    """
    if not points:
        return []
    
    unique_points = [points[0]]
    
    for pt in points[1:]:
        is_duplicate = False
        for existing_pt in unique_points:
            if pt.DistanceTo(existing_pt) < min_distance:
                is_duplicate = True
                break
        if not is_duplicate:
            unique_points.append(pt)
    
    return unique_points


def build_segmented_lines(crossbars_points, max_distance):
    """
    Create segmented lines from crossbar points.
    
    Args:
        crossbars_points: Crossbar point lists
        max_distance: Maximum distance between points in a segment
    
    Returns:
        Tuple of (segmented lines, lonely points)
    """
    all_segments = []
    lonely_points = []

    for pt_list in crossbars_points:
        if len(pt_list) < 2:
            lonely_points.extend(pt_list)
            continue

        segment = []
        i = 0
        while i < len(pt_list) - 1:
            pt_a = pt_list[i]
            pt_b = pt_list[i + 1]
            dist = pt_a.DistanceTo(pt_b)

            if dist <= max_distance:
                if not segment:
                    segment.append(pt_a)
                segment.append(pt_b)
            else:
                if len(segment) >= 2:
                    poly = rg.Polyline(segment)
                    all_segments.append(rg.PolylineCurve(poly))
                elif len(segment) == 1:
                    lonely_points.append(segment[0])
                segment = []

            i += 1

        # final segment
        if len(segment) == 1:
            lonely_points.append(segment[0])
        elif len(segment) >= 2:
            poly = rg.Polyline(segment)
            all_segments.append(rg.PolylineCurve(poly))

        # final check
        if i == len(pt_list) - 1 and not any(pt_list[i] == pt for pt in segment):
            lonely_points.append(pt_list[i])

    # remove duplicates from lonely_points
    lonely_points = remove_duplicate_points(lonely_points, GLOBAL_TOL)

    return all_segments, lonely_points


def polylines_to_lines(poly_curves):
    """
    Convert polylines to simple lines.
    
    Args:
        poly_curves: List of polylines
    
    Returns:
        List of lines
    """
    lines = []
    for crv in poly_curves:
        if isinstance(crv, rg.PolylineCurve):
            start_pt = crv.PointAtStart
            end_pt = crv.PointAtEnd
            lines.append(rg.Line(start_pt, end_pt))
        elif isinstance(crv, rg.Polyline):
            if crv.Count >= 2:
                lines.append(rg.Line(crv[0], crv[-1]))
    return lines


def match_support_to_boundary(support_lines, boundary_lines, direction, threshold):
    """
    Match support lines to boundary lines based on projection.
    
    Args:
        support_lines: Support lines
        boundary_lines: Boundary lines
        direction: Direction for projection
        threshold: Distance threshold for matching
    
    Returns:
        List of group indices for support lines
    """
    direction = rg.Vector3d(direction)
    direction.Unitize()

    boundary_projections = []
    for i, line in enumerate(boundary_lines):
        center = line.PointAt(0.5)
        proj = rg.Vector3d(center) * direction
        boundary_projections.append((i, proj))

    support_groups = []
    for line in support_lines:
        center = line.PointAt(0.5)
        proj = rg.Vector3d(center) * direction

        best_idx = -1
        min_dist = float("inf")
        for i, b_proj in boundary_projections:
            dist = abs(proj - b_proj)
            if dist < threshold and dist < min_dist:
                best_idx = i
                min_dist = dist

        support_groups.append(best_idx)  # -1 if no match

    return support_groups


def move_line_to_match_projection(source_line, target_line, direction):
    """
    Move a line to match the projection of the target line.
    
    Args:
        source_line: Source line to move
        target_line: Target line to match
        direction: Projection direction
    
    Returns:
        Moved line
    """
    direction = rg.Vector3d(direction)
    direction.Unitize()

    # Displacement along direction
    source_center = source_line.PointAt(0.5)
    target_center = target_line.PointAt(0.5)
    vec = rg.Vector3d(target_center) - rg.Vector3d(source_center)
    shift = direction * (vec * direction)

    moved_from = source_line.From + shift
    moved_to = source_line.To + shift

    # Construction of a perpendicular vector (XY plane)
    perp = rg.Vector3d(-direction.Y, direction.X, 0)
    perp.Unitize()

    # All points for projection
    points = [
        moved_from,
        moved_to,
        target_line.From,
        target_line.To
    ]

    # Projection onto perp
    projections = [(pt, rg.Vector3d(pt) * perp) for pt in points]
    min_pt = min(projections, key=lambda x: x[1])[0]
    max_pt = max(projections, key=lambda x: x[1])[0]

    # We return the new extended line, which is shifted as before, but stretched along the perpendicular.
    return rg.Line(min_pt, max_pt)


def filter_and_align_lines(boundary_lines, support_lines, support_indices, direction):
    """
    Filter and align lines based on their matching.
    
    Args:
        boundary_lines: Boundary lines
        support_lines: Support lines
        support_indices: Matching indices
        direction: Alignment direction
    
    Returns:
        Tuple of (filtered boundary lines, filtered support lines)
    """
    direction = rg.Vector3d(direction)
    direction.Unitize()

    groups = defaultdict(list)
    boundary_lookup = {}
    used_support_idxs = set()
    used_boundary_idxs = set()

    # 1. Draw boundary lines
    for i, line in enumerate(boundary_lines):
        groups[i].append(("boundary", i, line))
        boundary_lookup[i] = line

    # 2. Add support lines to groups
    for idx, (line, group_idx) in enumerate(zip(support_lines, support_indices)):
        if group_idx != -1:
            groups[group_idx].append(("support", idx, line))

    # 3. Вибір найдовшої лінії у групі
    selected_boundary = []
    selected_support = []

    for group_idx, items in groups.items():
        longest = max(items, key=lambda item: item[2].Length)

        # Позначаємо всі лінії як "використані"
        for item in items:
            if item[0] == "support":
                used_support_idxs.add(item[1])
            else:
                used_boundary_idxs.add(item[1])

        # Додаємо до обраного
        if longest[0] == "support":
            support_idx = longest[1]
            moved = move_line_to_match_projection(longest[2], boundary_lookup[group_idx], direction)
            selected_support.append(moved)
        else:
            selected_boundary.append(longest[2])

    # 4. Додаємо лінії, що не входили до груп
    for i, line in enumerate(support_lines):
        if i not in used_support_idxs:
            selected_support.append(line)

    for i, line in enumerate(boundary_lines):
        if i not in used_boundary_idxs:
            selected_boundary.append(line)

    return selected_boundary, selected_support


def generate_points_on_lines(lines, step):
    """
    Creates points on lines with a given step.
    
    Args:
        lines: List of lines
        step: Step between points
        
    Returns:
        List of points on lines
    """
    points = []
    for line in lines:
        length = line.Length
        num_points = int(length / step)
        
        if num_points == 0:
            # If the line is shorter than a step, add at least the start and end points.
            points.append(line.From)
            points.append(line.To)
            continue
            
        for i in range(num_points + 1):
            t = i / num_points
            point = line.PointAt(t)
            points.append(point)
            
    return points


def merge_lines_by_distance(lines, max_distance, length_tolerance=GLOBAL_TOL):
    """
    Connects lines that are within a specified distance and have the same length.
    
    Algorithm:
    1. Find the midpoints of all lines
    2. Group lines by distance between centers and length
    3. For each group, leave one line centered in the group.
    
    Args:
        lines: List of lines to merge
        max_distance: Maximum distance for merging
        length_tolerance: Permissible difference in line lengths for merging
    
    Returns:
        List of merged lines
    """
    if not lines or len(lines) < 2:
        return lines
    
    # Find the center points and lengths of all lines
    centers_and_lengths = []
    for i, line in enumerate(lines):
        center = line.PointAt(0.5)
        length = line.Length
        centers_and_lengths.append((i, center, length))
    
    # Group lines by distance and length
    groups = []
    used_indices = set()
    
    for i, (idx1, center1, length1) in enumerate(centers_and_lengths):
        if idx1 in used_indices:
            continue
            
        # Creating a new group
        current_group = [idx1]
        used_indices.add(idx1)
        
        # Find all lines within the distance and with the same length
        changed = True
        while changed:
            changed = False
            for j, (idx2, center2, length2) in enumerate(centers_and_lengths):
                if idx2 in used_indices:
                    continue
                    
                # Check if the lengths are the same (with tolerance)
                if abs(length2 - length1) > length_tolerance:
                    continue
                    
                # Check that all lines in the current group are within range
                in_range = True
                for group_idx in current_group:
                    group_center = centers_and_lengths[group_idx][1]
                    if center2.DistanceTo(group_center) > max_distance:
                        in_range = False
                        break
                
                if in_range:
                    current_group.append(idx2)
                    used_indices.add(idx2)
                    changed = True
        
        groups.append(current_group)
    
    # Creating merged lines
    merged_lines = []
    
    for group in groups:
        if len(group) == 1:
            # Find the center of the group
            merged_lines.append(lines[group[0]])
        else:
            # Find the center of the group
            group_centers = [centers_and_lengths[idx][1] for idx in group]
            avg_center = rg.Point3d(0, 0, 0)
            for center in group_centers:
                avg_center += center
            avg_center /= len(group_centers)
            
            # Take the longest line from the group as a basis (although they are all the same length).
            longest_line_idx = max(group, key=lambda idx: lines[idx].Length)
            base_line = lines[longest_line_idx]
            
            # Move the line to the center of the group
            current_center = base_line.PointAt(0.5)
            shift_vector = avg_center - current_center
            
            # Create a new line offset to the center of the group
            new_from = base_line.From + shift_vector
            new_to = base_line.To + shift_vector
            merged_line = rg.Line(new_from, new_to)
            
            merged_lines.append(merged_line)
    
    return merged_lines


#=== S1 ===========================================================================================================================

aligned_lines, reference_direction = line_same_direction(LINES)

start_pt = suspension_corners(
    aligned_lines, 
    reference_direction, 
    ROUNDING,  
    MIN_DISTANCE_CORNER, 
    is_start = True
)
end_pt = suspension_corners(
    aligned_lines, 
    reference_direction, 
    ROUNDING,  
    MIN_DISTANCE_CORNER, 
    is_start = False
)

start_index, start_group_pts = strict_cluster_points(
    start_pt, 
    reference_direction, 
    MAX_DISTANCE_CORNER, 
    is_start=True
)

end_index, end_group_pts = strict_cluster_points(
    end_pt, 
    reference_direction, 
    MAX_DISTANCE_CORNER, 
    is_start=False
)

aligned_start_pts = project_points_to_group_scalar(
    start_pt, 
    start_index, 
    start_group_pts, 
    reference_direction
)

aligned_end_pts = project_points_to_group_scalar(
    end_pt, 
    end_index, 
    end_group_pts, 
    reference_direction
)

# geometry for angles, lines, and points
start_line, start_lonely, start_one_point_for_group = grouped_polylines_by_index(aligned_start_pts, start_index)
end_line, end_lonely, end_one_point_for_group = grouped_polylines_by_index(aligned_end_pts, end_index)

# one point for group
one_point_for_group = start_one_point_for_group + end_one_point_for_group

#=== S2 ============================================================================================================================

# central lines without the part occupying the corners
cut_line = connect_point_pairs(aligned_start_pts, aligned_end_pts)


crossbars_points = generate_crossbars_points(cut_line, SUSPENSION_STEP, one_point_for_group)
#a = [pt for sublist in crossbars_points for pt in sublist]

safe_support_lines, orphaned_points = build_segmented_lines(crossbars_points, MAX_DIST_B_PT_CENTER)


start_line = polylines_to_lines(start_line)
end_line = polylines_to_lines(end_line)
boundary_lines = start_line + end_line

# If the lines are too close to each other (beginning and end), remove one and move the other to the center point.
boundary_lines = merge_lines_by_distance(boundary_lines, DISTANCE_JOINING_START_END_LINES)

safe_support_lines = polylines_to_lines(safe_support_lines)

# indices for grouping by distance between two types
support_indices = match_support_to_boundary(
    safe_support_lines,
    boundary_lines,
    reference_direction,
    THRESHOLD_FILTER
)

# two types of edited lines (those on the left and those in the middle)
boundary_lines_filtered, safe_support_lines_filtered = filter_and_align_lines(
    boundary_lines,
    safe_support_lines,
    support_indices,
    reference_direction
)

#====== OUTPUT =================================================================================================================

unistrut_lines = boundary_lines_filtered + safe_support_lines_filtered
rods_points = generate_points_on_lines(unistrut_lines, RODS_STEP)
single_rods_points = start_lonely + end_lonely + orphaned_points
# ---------- end python_4 ----------
crv_3 = Curve(python_4.unistrut_lines)
pt = Point(python_4.single_rods_points)
pt_2 = Point(python_4.rods_points)

geo = Geometry([pt_2, crv_3])
geo_2 = Geometry(clean)

panel_2 = Panel(python_4.out)

symsim = SymbolSimple(Style=5, Size=Slider(4, range=0..10), Rotation=0, Colour=ColourSwatch(SwatchColor=RGB(0, 207, 172)))
symsim_2 = SymbolSimple(Style=5, Size=Slider(4, range=0..10), Rotation=0, Colour=ColourSwatch(SwatchColor=RGB(207, 0, 176)))
previewlw = CustomPreviewLineweights(
    Geometry=crv_3,
    Shader=ColourSwatch(SwatchColor=RGB(0, 157, 255)),
    Thickness=Slider(4, range=0..20),
    Absolute=invert(False))
symbol = SymbolDisplay(Location=pt_2, Display=symsim)
symbol_2 = SymbolDisplay(Location=pt, Display=symsim_2)

threshold_filter = Number(number_slider)
line = Line(python_4.safe_support_lines)
int = Integer(python_4.support_indices)
midpt = CurveMiddle(Curve=line)
cir = Circle(Plane=midpt, Radius=threshold_filter)
swatch = ColourSwatch(SwatchColor=RGB(213, 0, 255))
dash = DashPattern(Curve=line, Pattern=Slider(1, range=0..10))  # -> Dashes, Gaps
dash_2 = DashPattern(Curve=cir, Pattern=Slider(4, range=0..10))  # -> Dashes, Gaps
tag = TextTag3D(Location=midpt, Text=int, Size=Slider(6, range=0..10), Colour=swatch, Justification=7)
previewlw_2 = CustomPreviewLineweights(Geometry=[dash_2.Dashes, dash.Dashes], Shader=swatch, Thickness=Slider(1, range=0..20), Absolute=False)

crv_4 = Curve(python_4.cut_line)
previewlw_3 = CustomPreviewLineweights(Geometry=crv_4, Shader=ColourSwatch(SwatchColor=RGB(0, 31, 189)), Thickness=Slider(1, range=0..20), Absolute=False)
