# Grasshopper definition temp_01.gh (Grasshopper 1.0.7)

python = GhPythonScript()  # -> out, a; inputs OPEN_MAIN_BRANCH: Boolean
# ---------- python: Python ----------
import System
import webbrowser
import clr
import os

GIT_URL = "https://github.com/Andrupavlov/GHDoc-temp"

def open_url_in_thread(url):
    def thread_func():
        webbrowser.open(url)
    t = System.Threading.Thread(System.Threading.ThreadStart(thread_func))
    t.IsBackground = True
    t.Start()

if OPEN_MAIN_BRANCH:
    open_url_in_thread(GIT_URL)

def get_gh_filename():
    """
    Returns the name of the current Grasshopper file without the extension.
    If the file is not saved, returns None.
    """
    doc = ghenv.Component.OnPingDocument()
    file_path = doc.FilePath
    
    if not file_path:
        return None
    
    file_name = os.path.basename(file_path)
    name_without_ext = os.path.splitext(file_name)[0]
    return name_without_ext

a = get_gh_filename()
# ---------- end python ----------
python_2 = GhPythonScript(OPEN_MAIN_BRANCH=Button(), OPEN_HELP_IN_GITHUB=Button())  # -> out, a; inputs OPEN_MAIN_BRANCH: Boolean
# ---------- python_2: Python ----------
import System
import webbrowser
import clr
import os

REPO_URL = "https://github.com/Andrupavlov/GHDoc-temp"
SUBFOLDER_IN_REPO = "Doc"

def open_url_in_thread(url):
    def thread_func():
        webbrowser.open(url)
    t = System.Threading.Thread(System.Threading.ThreadStart(thread_func))
    t.IsBackground = True
    t.Start()

def get_gh_filename():
    doc = ghenv.Component.OnPingDocument()
    file_path = doc.FilePath
    if not file_path:
        print "File not saved"
        return None, None

    file_name = os.path.basename(file_path)
    name_without_ext = os.path.splitext(file_name)[0]
    folder = os.path.dirname(file_path)
    return name_without_ext, folder

def find_git_root(start_folder):
    current = start_folder
    while current and current != os.path.dirname(current):
        if os.path.isdir(os.path.join(current, ".git")):
            return current
        current = os.path.dirname(current)
    return None

def get_git_branch(git_root_folder):
    head_path = os.path.join(git_root_folder, ".git", "HEAD")
    if not os.path.exists(head_path):
        print ".git/HEAD does not exist"
        return None

    with open(head_path, "r") as f:
        content = f.read().strip()
        if content.startswith("ref: refs/heads/"):
            return content.replace("ref: refs/heads/", "")
        else:
            return None

def open_github_doc(base_repo_url, doc_subfolder="Doc"):
    file_name, file_folder = get_gh_filename()
    if not file_name or not file_folder:
        return

    git_root = find_git_root(file_folder)
    if not git_root:
        print "No .git found in directories above"
        return

    branch = get_git_branch(git_root)
    if not branch:
        return

    # Link to an .md file with the same name
    github_path = base_repo_url + "/blob/" + branch + "/" + doc_subfolder + "/" + file_name + ".md"

    # Open in browser in a separate thread
    def thread_func():
        webbrowser.open(github_path)

    t = System.Threading.Thread(System.Threading.ThreadStart(thread_func))
    t.IsBackground = True
    t.Start()

    return github_path


if OPEN_MAIN_BRANCH:
    open_url_in_thread(REPO_URL)

if OPEN_HELP_IN_GITHUB:
    open_github_doc(REPO_URL, doc_subfolder=SUBFOLDER_IN_REPO)
# ---------- end python_2 ----------
python_3 = GhPythonScript(x=Button())  # -> out, a
# ---------- python_3: Python ----------
import os
import System
import webbrowser

def get_gh_filename():
    doc = ghenv.Component.OnPingDocument()
    file_path = doc.FilePath
    if not file_path:
        print "Файл не збережено"
        return None, None

    file_name = os.path.basename(file_path)
    name_without_ext = os.path.splitext(file_name)[0]
    folder = os.path.dirname(file_path)
    return name_without_ext, folder

def find_git_root(start_folder):
    current = start_folder
    while current and current != os.path.dirname(current):
        if os.path.isdir(os.path.join(current, ".git")):
            return current
        current = os.path.dirname(current)
    return None

def get_git_branch(git_root_folder):
    head_path = os.path.join(git_root_folder, ".git", "HEAD")
    if not os.path.exists(head_path):
        print ".git/HEAD не існує"
        return None

    with open(head_path, "r") as f:
        content = f.read().strip()
        if content.startswith("ref: refs/heads/"):
            return content.replace("ref: refs/heads/", "")
        else:
            return None

def open_github_doc(base_repo_url, doc_subfolder="Doc"):
    file_name, file_folder = get_gh_filename()
    if not file_name or not file_folder:
        return

    git_root = find_git_root(file_folder)
    if not git_root:
        print "Не знайдено .git у директоріях вище"
        return

    branch = get_git_branch(git_root)
    if not branch:
        return

    # Посилання на .md-файл із такою ж назвою
    github_path = base_repo_url + "/blob/" + branch + "/" + doc_subfolder + "/" + file_name + ".md"

    # Відкрити в браузері в окремому потоці
    def thread_func():
        webbrowser.open(github_path)

    t = System.Threading.Thread(System.Threading.ThreadStart(thread_func))
    t.IsBackground = True
    t.Start()

    return github_path  # можеш побачити URL в `a`

# === Налаштування ===
repo_url = "https://github.com/Andrupavlov/GHDoc-temp"
subfolder_in_repo = "Doc"

if x:
    a = open_github_doc(repo_url, doc_subfolder=subfolder_in_repo)
    print a
# ---------- end python_3 ----------
panel = Panel(python_3.a)
panel_2 = Panel(python_3.out)
panel_3 = Panel(python_2.out)
panel_4 = Panel(python_2.a)
